# Dynamo graph FaceAreaToCustomProperty.dyn (Dynamo 1.2.2.373)

code_block = CodeBlock { "面积"; }
string = StringInput("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")
byPID = SldWorksNodes.Brep.Face.ByPID(string)
area = SldWorksNodes.Brep.Face.Area(byPID)
string_from_object = FromObject(area)
byNameText = SldWorksNodes.CustomProperty.CustomPropertyCreation.ByNameText(code_block, string_from_object)
