# Dynamo graph Geometry.dyn (Dynamo 1.2.2.373)

code_block = CodeBlock { 0; }
code_block_2 = CodeBlock { 2; 10; 5; }
number_slider = DoubleSlider(20, range=0..100 step 5)
sequence = Sequence(start=code_block_2.out0, amount=number_slider, step=code_block_2.out2, lacing=Longest)
byCoordinates = SldWorksNodes.Geometry.Point3D.ByCoordinates(code_block, code_block, sequence)
ZAxis = SldWorksNodes.Geometry.Vector3D.ZAxis()
byCenterAxisRaduisHeight = SldWorksNodes.Geometry.Cylinder.ByCenterAxisRaduisHeight(byCoordinates, ZAxis, sequence, code_block_2.out2)
