# Dynamo graph ReNameDocByProperties.dyn (Dynamo 1.2.2.373)

# group: Input
名称 = StringInput("Block")
材料 = StringInput("QT450")

# group: ValueContact
code_block = CodeBlock { "名称"; "材料"; "-"; }
名称_2 = SldWorksNodes.CustomProperty.CustomPropertyCreation.ByNameText(code_block.out0, 名称)
value = SldWorksNodes.CustomProperty.CustomProperty.Value(名称_2)
材质 = SldWorksNodes.CustomProperty.CustomPropertyCreation.ByNameText(code_block.out1, 材料)
value_2 = SldWorksNodes.CustomProperty.CustomProperty.Value(材质)
concat = String.Concat(value, code_block.out2, value_2)

# group: ReName
current = SldWorksNodes.Document.Document.Current()
reName = SldWorksNodes.Document.Document.ReName(current, concat)
