# Dynamo graph SketchLine.dyn (Dynamo 2.13.1.3887)

select_feature = SelectFeature()  # 1 picked in the model; graph input
byFeature = SldWorksNodes.Sketch.Sketch.ByFeature(skeFeature=select_feature)
code_block = CodeBlock { 0; 10; }
byCoordinates = SldWorksNodes.Geometry.Point3D.ByCoordinates(x=code_block.out0, y=code_block.out0, z=code_block.out0)
number_slider = DoubleSlider(370, range=0..1000 step 10)  # graph input
byCoordinates_2 = SldWorksNodes.Geometry.Point3D.ByCoordinates(x=number_slider, y=number_slider, z=code_block.out1)
