# Dynamo graph extrued.dyn (Dynamo 2.13.1.3887)

orign = SldWorksNodes.Geometry.Point3D.Orign()
code_block = CodeBlock { 10; }
byCenterPointRadius = SldWorksNodes.Geometry.Circle.ByCenterPointRadius(center=orign, radius=code_block)
list_create = List.Create(item0=byCenterPointRadius)
code_block_2 = CodeBlock { 15; Vector3D.ByCoordinates(0,1,1); }
byExtrued = SldWorksNodes.Geometry.SolidBody.ByExtrued(curves=list_create, direction=code_block_2.out1, length=code_block_2.out0)
