# Dynamo graph tower.dyn "twoer" (Dynamo 2.13.1.3887)

orign = SldWorksNodes.Geometry.Point3D.Orign()
code_block = CodeBlock { 20; }
byCenterPointRadius = SldWorksNodes.Geometry.Circle.ByCenterPointRadius(center=orign, radius=code_block)

# group: InputData
number_slider = DoubleSlider(50, range=0..100 step 1)
number_slider_2 = DoubleSlider(60, range=0..100 step 0.1)

code_block_2 = CodeBlock { 10; 0; 100; }
byCoordinates = SldWorksNodes.Geometry.Point3D.ByCoordinates(x=code_block_2.out1, y=code_block_2.out1, z=code_block_2.out2)
byCenterPointRadius_2 = SldWorksNodes.Geometry.Circle.ByCenterPointRadius(center=byCoordinates, radius=number_slider_2)

# group: Data
pointsAtEqualChordLength = SldWorksNodes.Geometry.Curve.PointsAtEqualChordLength(curve=byCenterPointRadius, divisions=number_slider)
code_block_3 = CodeBlock { 1; 8; 0; }
code_block_4 = CodeBlock { 10; 1; }
sub = number_slider - code_block_4.out1
slice = List.Slice(list=pointsAtEqualChordLength, start=code_block_3.out2, end=sub)
pointsAtEqualChordLength_2 = SldWorksNodes.Geometry.Curve.PointsAtEqualChordLength(curve=byCenterPointRadius_2, divisions=number_slider)
slice_2 = List.Slice(list=pointsAtEqualChordLength_2, start=code_block_3.out2, end=sub)

shiftIndices = List.ShiftIndices(list=slice_2, amount=number_slider_2)
byStartAndEnd = SldWorksNodes.Geometry.Line.ByStartAndEnd(startPoint=slice, endPoint=shiftIndices)
