# Dynamo graph 随机着色.dyn (Dynamo 1.2.2.373)

# group: 获取所有零件
current = SldWorksNodes.Document.Document.Current()
asAssemblyDocument = SldWorksNodes.Document.Document.AsAssemblyDocument(current)
顶级_全部 = BoolSelector(false)
components = SldWorksNodes.Document.AssemblyDocument.Components(asAssemblyDocument, 顶级_全部)

# group: 生成随机颜色
count = Count(components)
randomList = Math.RandomList(count)
code_block = CodeBlock { 0; 255; }
mul = randomList * code_block.out1
randomList_2 = Math.RandomList(count)
mul_2 = randomList_2 * code_block.out1
randomList_3 = Math.RandomList(count)
mul_3 = randomList_3 * code_block.out1

# group: 设置颜色
materialProperty = SldWorksNodes.MaterialProperty.MaterialProperty(mul, mul_2, mul_3)
setMaterialProperty = SldWorksNodes.Assembly.Component.SetMaterialProperty(components, materialProperty)
